# Grasshopper definition LeafGenerator.gh (Grasshopper 1.0.8)
# plug-ins: GH_MCP

grasshopper_mcp = GrasshopperMCP(Enabled=True, Port=8080)  # -> Status, LastCommand
X = Slider(1164, range=-5000..5000)
Y = Slider(1026, range=-5000..5000)
Z = Slider(29000, range=0..30000)
nozzle_azimuth_deg = Slider(46, range=-180..180)
nozzle_tilt_deg = Slider(-8, range=-90..90)
flow_rate_lpm = Slider(63.9, range=10..100)
dt_s = Slider(0.02, range=0.01..0.1)
pump_exit_speed_mps = Slider(1.5, range=0.5..5)
normal_absorb = Slider(0.8, range=0.5..0.99)
tangent_friction = Slider(0.2, range=0..0.5)
construct_point = ConstructPoint(XCoordinate=X, YCoordinate=Y, ZCoordinate=Z)
reference = Geometry([<mesh referenced from the Rhino model> x6])
panel = Panel(reference)
water_sim = Python3Script(
    reference_meshes=reference,
    nozzle_points=construct_point,
    flow_rate_lpm=flow_rate_lpm,
    tilt_deg=nozzle_tilt_deg,
    azimuth_deg=nozzle_azimuth_deg,
    pump_exit_speed_mps=pump_exit_speed_mps,
    dt_s=dt_s,
    normal_absorb=normal_absorb,
    tangent_friction=tangent_friction)  # -> out, a, b; inputs reference_meshes: list of Mesh, nozzle_points: list of Point3d, flow_rate_lpm: Double, tilt_deg: Double, azimuth_deg: Double, pump_exit_speed_mps: Double, dt_s: Double, normal_absorb: Double, tangent_friction: Double
# ---------- water_sim: Python ----------
# r: trimesh
# r: rtree
import sys, pathlib, importlib
import Rhino, Rhino.Geometry as rg
import trimesh
import numpy as np

REPO_ROOT = pathlib.Path(r"C:\Users\user\Documents\LFTH_CFD")
if str(REPO_ROOT) not in sys.path:
    sys.path.insert(0, str(REPO_ROOT))

import gh.scripts.water_sim
importlib.reload(gh.scripts.water_sim)
from gh.scripts.water_sim import simulate_water_curtain_dt

doc = Rhino.RhinoDoc.ActiveDoc
m_to_doc = Rhino.RhinoMath.UnitScale(Rhino.UnitSystem.Meters, doc.ModelUnitSystem)
m_to_doc = m_to_doc if m_to_doc != 0 else 1.0
doc_to_m = 1.0 / m_to_doc

# extract trimesh inline from Rhino Mesh objects (no JSON middle step)
verts, faces = [], []
for m in reference_meshes:
    base = len(verts)
    for v in m.Vertices:
        verts.append((v.X * doc_to_m, v.Y * doc_to_m, v.Z * doc_to_m))
    for f in m.Faces:
        faces.append((base + f.A, base + f.B, base + f.C))
        if f.IsQuad and f.D != f.C:
            faces.append((base + f.A, base + f.C, base + f.D))
tm = trimesh.Trimesh(
    vertices=np.asarray(verts, dtype=float),
    faces=np.asarray(faces, dtype=int),
    process=False,
)

# nozzle points -> meters
nozzles_m = [(p.X * doc_to_m, p.Y * doc_to_m, p.Z * doc_to_m) for p in nozzle_points]

# fluid CFD: pump exit speed (small) + time-step integration + splash response
trajectories = simulate_water_curtain_dt(
    tm, nozzles_m,
    flow_rate_lpm=flow_rate_lpm,
    tilt_deg=tilt_deg,
    azimuth_deg=azimuth_deg,
    pump_exit_speed_mps=pump_exit_speed_mps,
    dt_s=dt_s,
    normal_absorb=normal_absorb,
    tangent_friction=tangent_friction,
    max_steps=400,
)

curves = []
for traj in trajectories:
    pts = [rg.Point3d(x * m_to_doc, y * m_to_doc, z * m_to_doc) for (x, y, z) in traj.points]
    if len(pts) >= 2:
        curves.append(rg.Polyline(pts).ToNurbsCurve())

a = curves
b = "particles={}, pts/traj_avg={:.1f}, pond={}, pooled={}, collisions_total={}".format(
    len(trajectories),
    (sum(len(t.points) for t in trajectories) / max(1, len(trajectories))),
    sum(1 for t in trajectories if t.terminated_by == "pond"),
    sum(1 for t in trajectories if t.terminated_by == "pooled"),
    sum(t.n_collisions for t in trajectories),
)
# ---------- end water_sim ----------
panel_2 = Panel(water_sim.b)
panel_3 = Panel(water_sim.a)
panel_4 = Panel(water_sim.out)
